# Grasshopper definition Assign 01_Zoe.L.gh (Grasshopper 1.0.7)

set_poly_segment = GetInteger(
    Slider(8, range=0..10),
    AtLeast=1,
    AtMost=1,
    Maximum=2147483647,
    Minimum=-2147483648,
    Prompt="SET POLY SEGMENTS (min.3 - max.8)")
polygon = Polygon(Plane=PlaneXY(0, 0, 0), Radius=3, Segments=set_poly_segment, FilletRadius=0)  # -> Polygon, Length
set_grid_dimension = GetInteger(
    Slider(22, range=0..100),
    AtLeast=1,
    AtMost=1,
    Maximum=2147483647,
    Minimum=-2147483648,
    Prompt="SET GRID DIMENSION (min.12 - max.30)")
space_between_tubes = GetInteger(
    Slider(6, range=0..12),
    AtLeast=1,
    AtMost=1,
    Maximum=2147483647,
    Minimum=-2147483648,
    Prompt="SPACE BETWEEN TUBES (min.6 - max.12)")
series = Series(Start=0, Step=space_between_tubes, Count=set_grid_dimension)
unit_x = UnitX(Factor=series)
unit_y = UnitY(Factor=series)
move = Move(Geometry=polygon.Polygon, Motion=unit_x)  # -> Geometry, Transform
point = Point(<point referenced from the Rhino model>)
point_2 = Point(<point referenced from the Rhino model>)
point_3 = Point(<point referenced from the Rhino model>)
point_4 = Point(<point referenced from the Rhino model>)
point_5 = Point(<point referenced from the Rhino model>)
point_6 = Point(<point referenced from the Rhino model>)
cross_reference = CrossReference(ListA=move.Geometry, ListB=unit_y, CrossMode=1)  # -> ListA, ListB
pt_interpolate_crv = GetPoint([point_5, point, point_2, point_3, point_4, point_6], AtLeast=3, AtMost=7, Prompt="POINT 1", Realtime=True)
move_2 = Move(Geometry=cross_reference.ListA, Motion=cross_reference.ListB)  # -> Geometry, Transform
area = Area(Geometry=move_2.Geometry)  # -> Area, Centroid
interpolate = Interpolate(Vertices=pt_interpolate_crv, Degree=3, Periodic=False, KnotStyle=1)  # -> Curve, Length, Domain
curve_closest_point = CurveClosestPoint(Point=area.Centroid, Curve=interpolate.Curve)  # -> Point, Parameter, Distance
bounds = Bounds(Numbers=curve_closest_point.Distance)
min_tube_diam = GetNumber(
    Slider(0.03, range=0..0.03),
    AtLeast=1,
    AtMost=1,
    Maximum=1.797693135e+308,
    Minimum=-1.797693135e+308,
    Prompt="MIN TUBE DIAM (min.0.01 - max.0.03)")
max_tube_diam = GetNumber(
    Slider(1, range=0..10),
    AtLeast=1,
    AtMost=1,
    Maximum=1.797693135e+308,
    Minimum=-1.797693135e+308,
    Prompt="MAX TUBE DIAM (min. 0.7 - max.2.5)")
construct_domain = ConstructDomain(DomainStart=min_tube_diam, DomainEnd=max_tube_diam)
remap_numbers = RemapNumbers(Value=curve_closest_point.Distance, Source=bounds, Target=construct_domain)  # -> Mapped, Clipped
scale = Scale(Geometry=move_2.Geometry, Center=area.Centroid, Factor=remap_numbers.Mapped)  # -> Geometry, Transform
gradient = Gradient(
    LowerLimit=0,
    UpperLimit=1,
    Parameter=remap_numbers.Mapped,
    stops=[0: RGB(74, 255, 149), 0: RGB(64, 70, 230), 0: RGB(170, 27, 135), 0: RGB(120, 169, 78), 0: RGB(29, 108, 10), 0: RGB(106, 51, 1), 0: RGB(28, 189, 33), 0.328: RGB(0, 240, 140), 0.635: RGB(245, 130, 255), 0.965: RGB(255, 99, 206)])
max_tube_height = GetInteger(
    Slider(29, range=0..100),
    AtLeast=1,
    AtMost=1,
    Maximum=2147483647,
    Minimum=-2147483648,
    Prompt="MAX TUBE HEIGHT (min.5 - max.30)")
multiplication = Multiplication(A=remap_numbers.Mapped, B=max_tube_height)
unit_z = UnitZ(Factor=multiplication)
extrude = Extrude(Base=scale.Geometry, Direction=unit_z)
context_bake = ContextBake(Geometry=extrude)
custom_preview = CustomPreview(Geometry=extrude, Material=gradient)
